# Dynamo graph Elements_sorting_algorithm.dyn "Алгоритм сортировки элементов" (Dynamo 2.0.2.6826)

select_model_elements = DSModelElementsSelection()  # 21 picked in the model
python_script = Python(IN[0]=select_model_elements)
# ---------- python_script.python (49 lines) ----------
# Включить поддержку Python и загрузить библиотеку DesignScript
import clr
clr.AddReference('ProtoGeometry')
from Autodesk.DesignScript.Geometry import *
clr.AddReference("RevitNodes")
import Revit
from Revit.Elements import*

# Введенные в этом узле данные сохраняется в виде списка в переменных IN.
dataEnteringNode = IN

Elements=IN[0]
LocationPoints=[]
for i in Elements:
	LocationPoints.append(i.GetLocation())
Distance=[]
SortedPoints=[]

j=0
SortedPoints.append(LocationPoints.pop())

while len(LocationPoints)>0 or j>100:
	MinDist = 49900
	Index = -1
	#reverse = False
	for i in range(len(LocationPoints)):
		Dist1 = SortedPoints[0].DistanceTo(LocationPoints[i])
		Dist2 = SortedPoints[len(SortedPoints)-1].DistanceTo(LocationPoints[i])
		if Dist1 < MinDist:
			MinDist = Dist1
			Index = i
			reverse = True
		if Dist2 < MinDist:
			MinDist = Dist2
			Index = i
			reverse = False
	if Index == -1:
		break		
	else:
		if reverse==True:	
			SortedPoints.reverse()	
		SortedPoints.append(LocationPoints[Index])
		del LocationPoints[Index]
	j=j+1
	
# Разместите код под этой строкой

# Назначьте вывод переменной OUT.
OUT = SortedPoints
# ----------------------------------------
byPoints = PolyCurve.ByPoints(points=python_script)
explode = Geometry.Explode(geometry=byPoints)
byCurve = ModelCurve.ByCurve(curve=explode)
