# Dynamo graph Expose Fabrication Properties.dyn (Dynamo 2.0.2.6826)

element_types = ElementTypes(index=111)  # graph input
all_elements_of_type = ElementsOfType(element_type=element_types)
code_block = CodeBlock { "Fabrication ServiceType"; }
part_s_servicetype = Custom[Part(s) ServiceType](all_elements_of_type)  # Get Fabrication Part(s) service type
setParameterByName = Element.SetParameterByName(element=all_elements_of_type, parameterName=code_block, value=part_s_servicetype)
code_block_2 = CodeBlock { "Fabrication ItemCID"; }
part_s_cid_number = Custom[Part(s) CID Number](Item_s=all_elements_of_type)  # Gets the CID number
string_from_object = FromObject(obj=part_s_cid_number.CID_s)
setParameterByName_2 = Element.SetParameterByName(element=all_elements_of_type, parameterName=code_block_2, value=string_from_object)
code_block_3 = CodeBlock { "Fabrication ProductListName"; }
part_s_current_product_list = Custom[Part(s) Current Product List Entry](Item_s=all_elements_of_type)  # Get the current Product list entry for the part(s)
setParameterByName_3 = Element.SetParameterByName(element=all_elements_of_type, parameterName=code_block_3, value=part_s_current_product_list.Product_List_Name)
connector_s_information = Custom[Connector(s) Information](Item_s=all_elements_of_type)  # Gets the connector(s) information.
get_all_part_statuses = Custom[Get All Part Statuses]()  # Gets Fabrication part statuses from database
get_custom_data = Custom[Get Custom Data]()
get_all_fabrication_dampers = Custom[Get All Fabrication Dampers]()
part_s_rod_length = Custom[Part(s) Rod Length](Part_s=all_elements_of_type)  # Gets Fabrication part rod length(s)
setParameterByName_4 = Element.SetParameterByName(element=all_elements_of_type, value=part_s_rod_length.Rod_Length)  # unwired: parameterName
code_block_4 = CodeBlock { "Fabrication Rod Length"; }
code_block_5 = CodeBlock { ["838"]; }
if_ = If(test=code_block_5, true=part_s_cid_number.Part_ID)  # unwired: false
code_block_6 = CodeBlock { "Material"; }
categories = Categories(index=296)
all_elements_of_category = ElementsOfCategory(Category=categories)
name = Element.Name(element=all_elements_of_category)
code_block_7 = CodeBlock { "Fabrication Service Name"; }
getParameterValueByName = Element.GetParameterValueByName(element=all_elements_of_type, parameterName=code_block_7)
flatten = List.Flatten(list=getParameterValueByName)
uniqueItems = List.UniqueItems(list=flatten)
setIntersection = List.SetIntersection(list1=uniqueItems, list2=name)
contains = String.Contains(str=name, searchFor=setIntersection)
filterByBoolMask = List.FilterByBoolMask(list=all_elements_of_category, mask=contains)
setParameterByName_5 = Element.SetParameterByName(element=all_elements_of_type, parameterName=code_block_6, value=filterByBoolMask.in)
code_block_8 = CodeBlock { "CALP"; }
code_block_9 = CodeBlock { "EAHP"; }
code_block_10 = CodeBlock { "EALP"; }
code_block_11 = CodeBlock { "EAHP"; }
code_block_12 = CodeBlock { "EPVC"; }
code_block_13 = CodeBlock { "EWLD"; }
code_block_14 = CodeBlock { "OALP"; }
code_block_15 = CodeBlock { "RAHP"; }
code_block_16 = CodeBlock { "RALP"; }
code_block_17 = CodeBlock { "RAMP"; }
code_block_18 = CodeBlock { "SAHP"; }
code_block_19 = CodeBlock { "SALP"; }
code_block_20 = CodeBlock { "SAMP"; }
code_block_21 = CodeBlock { "T/H/S EQUIP"; }
code_block_22 = CodeBlock { "TALP"; }
list_create = List.Create(item1=code_block_8, item3=code_block_9, item4=code_block_10, item5=code_block_11, item6=code_block_12, item7=code_block_13, item8=code_block_14, item9=code_block_15, item10=code_block_16, item11=code_block_17, item12=code_block_18, item13=code_block_19, item14=code_block_20, item15=code_block_21, item16=code_block_22)  # unwired: item0, item2
setIntersection_2 = List.SetIntersection(list1=list_create, list2=uniqueItems)

# group: Get All Fabrication Parts
lunchbox_get_parameter_value = Custom[LunchBox Get Parameter Value]()  # unwired: Element, ParamName
element_types_2 = ElementTypes(index=111)
all_elements_of_type_2 = ElementsOfType(element_type=element_types_2)
code_block_23 = CodeBlock { "System Name"; }
getParameterValueByName_2 = Element.GetParameterValueByName(element=all_elements_of_type_2, parameterName=code_block_23)
flatten_2 = List.Flatten(list=getParameterValueByName_2)
uniqueItems_2 = List.UniqueItems(list=flatten_2)

# group: Get Material Element ID
categories_2 = Categories(index=296)
all_elements_of_category_2 = ElementsOfCategory(Category=categories_2)
watch = Watch(all_elements_of_category_2)
name_2 = Element.Name(element=watch)
watch_2 = Watch(name_2)

# group: Get Material ID based on Fabrication Service Abbr.
contains_2 = Custom[String.Contains]()  # unwired: StringList, FilterList
setIntersection_3 = List.SetIntersection(list1=uniqueItems_2, list2=watch_2)
contains_3 = String.Contains(str=watch_2, searchFor=setIntersection_3)
filterByBoolMask_2 = List.FilterByBoolMask(list=watch, mask=contains_3)

# group: Set Material for color change
code_block_24 = CodeBlock { "Material"; }
setParameterByName_6 = Element.SetParameterByName(element=all_elements_of_type_2, parameterName=code_block_24, value=filterByBoolMask_2.in, lacing=Longest)

code_block_25 = CodeBlock { "SALP"; }
code_block_26 = CodeBlock { "AOR-03: 03) Supply Air (+2''WG) Low Pressure"; }
equals = List.Equals(objectA=code_block_26, objectB=uniqueItems_2)
replaceByCondition = Replace(item=uniqueItems_2, replaceWith=code_block_25, condition=equals)
watch_3 = Watch(replaceByCondition)
