# Dynamo graph Extract Pipe Segments.dyn (Dynamo 2.3.0.5885)

string = StringInput("C:\Users\BrennanL\AMC\BIM - Docs\_Management\AMC Software Management\Revit\Families\Custom Library\Pipe\Pipe Size Exports.xlsx")
code_block = CodeBlock { "Segments_Sizes"; }
code_block_2 = CodeBlock { 0; 1; }
code_block_3 = CodeBlock { "Pipes"; }
byName = Category.ByName(name=code_block_3)
all_elements_of_category = ElementsOfCategory(Category=byName)
code_block_4 = CodeBlock { "Nominal Dimension"; }
getParameterValueByName = Element.GetParameterValueByName(element=all_elements_of_category, parameterName=code_block_4)
boolean = BoolSelector(true)
filterByBoolMask = List.FilterByBoolMask(list=getParameterValueByName, mask=boolean)
code_block_5 = CodeBlock { 0; }
count = List.Count(list=getParameterValueByName)
range = Range(start=code_block_5, end=count)
takeItems = List.TakeItems(list=filterByBoolMask.in, amount=range)
boolean_2 = BoolSelector(false)
exportExcel = Data.ExportExcel(filePath=string, sheetName=code_block, startRow=code_block_2.out0, startCol=code_block_2.out1, data=takeItems, overWrite=boolean_2)
code_block_6 = CodeBlock { "Pipes"; }
byName_2 = Category.ByName(name=code_block_6)
all_elements_of_category_2 = ElementsOfCategory(Category=byName_2)
code_block_7 = CodeBlock { "Inside Diameter"; }
getParameterValueByName_2 = Element.GetParameterValueByName(element=all_elements_of_category_2, parameterName=code_block_7)
code_block_8 = CodeBlock { "Outside Diameter"; }
getParameterValueByName_3 = Element.GetParameterValueByName(element=all_elements_of_category_2, parameterName=code_block_8)
list_create = List.Create(item0=getParameterValueByName_2, item1=getParameterValueByName_3)
transpose = List.Transpose(lists=list_create)
code_block_9 = CodeBlock { 0; 0; }
code_block_10 = CodeBlock { "Segment Description"; }
getParameterValueByName_4 = Element.GetParameterValueByName(element=all_elements_of_category, parameterName=code_block_10)
boolean_3 = BoolSelector(true)
filterByBoolMask_2 = List.FilterByBoolMask(list=getParameterValueByName_4, mask=boolean_3)
code_block_11 = CodeBlock { 0; }
count_2 = List.Count(list=getParameterValueByName_4)
range_2 = Range(start=code_block_11, end=count_2)
takeItems_2 = List.TakeItems(list=filterByBoolMask_2.in, amount=range_2)
exportExcel_2 = Data.ExportExcel(filePath=string, sheetName=code_block, startRow=code_block_9.out0, startCol=code_block_9.out1, data=takeItems_2, overWrite=boolean_2)
code_block_12 = CodeBlock { 0; 2; }
code_block_13 = CodeBlock { "Inside Diameter"; }
getParameterValueByName_5 = Element.GetParameterValueByName(element=all_elements_of_category, parameterName=code_block_13)
boolean_4 = BoolSelector(true)
filterByBoolMask_3 = List.FilterByBoolMask(list=getParameterValueByName_5, mask=boolean_4)
code_block_14 = CodeBlock { 0; }
count_3 = List.Count(list=getParameterValueByName_5)
range_3 = Range(start=code_block_14, end=count_3)
takeItems_3 = List.TakeItems(list=filterByBoolMask_3.in, amount=range_3)
exportExcel_3 = Data.ExportExcel(filePath=string, sheetName=code_block, startRow=code_block_12.out0, startCol=code_block_12.out1, data=takeItems_3, overWrite=boolean_2)
code_block_15 = CodeBlock { 0; 3; }
code_block_16 = CodeBlock { "Outside Diameter"; }
getParameterValueByName_6 = Element.GetParameterValueByName(element=all_elements_of_category, parameterName=code_block_16)
boolean_5 = BoolSelector(true)
filterByBoolMask_4 = List.FilterByBoolMask(list=getParameterValueByName_6, mask=boolean_5)
code_block_17 = CodeBlock { 0; }
count_4 = List.Count(list=getParameterValueByName_6)
range_4 = Range(start=code_block_17, end=count_4)
takeItems_4 = List.TakeItems(list=filterByBoolMask_4.in, amount=range_4)
exportExcel_4 = Data.ExportExcel(filePath=string, sheetName=code_block, startRow=code_block_15.out0, startCol=code_block_15.out1, data=takeItems_4, overWrite=boolean_2)
