# Dynamo graph Fabrication MEP Colors.dyn (Dynamo 2.0.1.5055)

# group: Get All Fabrication Parts
element_types = ElementTypes(index=111)
all_elements_of_type = ElementsOfType(element_type=element_types)
code_block = CodeBlock { "Fabrication Service Name"; }
lunchbox_get_parameter_value = Custom[LunchBox Get Parameter Value](Element=all_elements_of_type, ParamName=code_block)  # Gets parameter values from a Revit element.
flatten = List.Flatten(list=lunchbox_get_parameter_value)
uniqueItems = List.UniqueItems(list=flatten)

# group: Get Material Element ID
categories = Categories(index=293)
all_elements_of_category = ElementsOfCategory(Category=categories)
watch = Watch(all_elements_of_category)
name = Element.Name(element=watch)
watch_2 = Watch(name)

# group: Get Material ID based on Fabrication Service Abbr.
setIntersection = List.SetIntersection(list1=uniqueItems, list2=watch_2)
contains = Custom[String.Contains](StringList=watch_2, FilterList=setIntersection)  # This node takes a list of strings and checks if any string contains a matching string from filter input.
filterByBoolMask = List.FilterByBoolMask(list=watch, mask=contains)

# group: Set Material for color change
code_block_2 = CodeBlock { "FAB_Material"; }
setParameterByName = Element.SetParameterByName(element=all_elements_of_type, parameterName=code_block_2, value=filterByBoolMask.in, lacing=Longest)
