# Dynamo graph Fabrication MEP Pipe Colors by Active View.dyn (Dynamo 2.0.1.5055)

# group: LIST AND SORT PIPEWORK ALPHABETICALLY BY SERVICE
categories = Categories(index=313)
all_elements_of_category = ElementsOfCategory(Category=categories)
code_block = CodeBlock { "Fabrication Service Name"; }
getParameterValueByName = Element.GetParameterValueByName(element=all_elements_of_category, parameterName=code_block)
groupByKey = List.GroupByKey(list=all_elements_of_category, keys=getParameterValueByName)
watch = Watch(groupByKey.unique_keys)
sortByKey = List.SortByKey(list=all_elements_of_category, keys=getParameterValueByName)
getParameterValueByName_2 = Element.GetParameterValueByName(parameterName=code_block)  # unwired: element
groupByFunction = List.GroupByFunction(list=sortByKey.sorted_list, func=getParameterValueByName_2)

# group: MATERIALS IN PROJECT
categories_2 = Categories(index=293)
all_elements_of_category_2 = ElementsOfCategory(Category=categories_2)
name = Element.Name(element=all_elements_of_category_2)
watch_2 = Watch(name)

# group: FAB SERVICE/MATERIAL MATCHING VALUES
setIntersection = List.SetIntersection(list1=groupByKey.unique_keys, list2=watch_2)
sort = List.Sort(list=setIntersection)

# group: SORT MATERIALS ALPHABETICALLY
contains = Custom[String.Contains](StringList=name, FilterList=sort)  # This node takes a list of strings and checks if any string contains a matching string from filter input.
filterByBoolMask = List.FilterByBoolMask(list=all_elements_of_category_2, mask=contains)
name_2 = Element.Name()  # unwired: element
sortByFunction = List.SortByFunction(list=filterByBoolMask.in, func=name_2)
name_3 = Element.Name(element=sortByFunction)
sortByKey_2 = List.SortByKey(list=sortByFunction, keys=name_3)
watch_3 = Watch(sortByKey_2.sorted_list)

# group: MATERIAL PARAMETER
code_block_2 = CodeBlock { "NWC_COLOR"; }
setParameterByName = Element.SetParameterByName(element=groupByFunction, parameterName=code_block_2, value=sortByKey_2.sorted_list)

# group: VERIFICATION
getParameterValueByName_3 = Element.GetParameterValueByName(element=setParameterByName, parameterName=code_block)
getParameterValueByName_4 = Element.GetParameterValueByName(element=setParameterByName, parameterName=code_block_2)
name_4 = Element.Name(element=getParameterValueByName_4)
eq = getParameterValueByName_3 == name_4
watch_4 = Watch(eq)

watch_5 = Watch(sort)
watch_6 = Watch(setParameterByName)
getParameterValueByName_5 = Element.GetParameterValueByName(element=groupByFunction, parameterName=code_block)
uniqueItems = List.UniqueItems(list=getParameterValueByName_5@L2, lacing=Shortest)
watch_7 = Watch(contains)
