# Dynamo graph Rename-Revit-Sheet-Number.dyn (Dynamo 1.3.2.2480)

# group: SELECT ALL SHEETS
categories = Categories("Sheets")
all_elements_of_category = ElementsOfCategory(categories)

# group: SORT THEM BY NUMBER
sheetNumber = Sheet.SheetNumber()  # unwired: arg0
sortByFunction = SortByFunction(all_elements_of_category, sheetNumber)
sheetNumber_2 = Sheet.SheetNumber(sortByFunction)
watch = Watch(sheetNumber_2)

# group: SPLIT SHEET LIST
first_sheet_id = IntegerSlider(0, range=0..1000 step 1)
last_sheet_id = IntegerSlider(15, range=0..1000 step 1)
code_block = CodeBlock { 1; }
slice = List.Slice(sortByFunction, first_sheet_id, last_sheet_id, code_block)
sheetNumber_3 = Sheet.SheetNumber(slice)
watch_2 = Watch(sheetNumber_3)

# group: CREATE SHEET NUMBER SEQUENCE
sequence_number_start = IntegerSlider(300, range=0..900 step 25)
count = List.Count(slice)
add = sequence_number_start + count
code_block_2 = CodeBlock { 1; }
range = Range(start=sequence_number_start, end=add, step=code_block_2, lacing=Longest)
watch_3 = Watch(range)
string_from_object = FromObject(range)

# group: CREATE TEMPORARY SHEET NAME
code_block_3 = CodeBlock { "Sheet Number"; }
setParameterByName = Element.SetParameterByName(element=slice, parameterName=code_block_3, value=string_from_object)
sheetNumber_4 = Sheet.SheetNumber(setParameterByName)
watch_4 = Watch(sheetNumber_4)

# group: CREATE FINAL SHEET NAME
code_block_4 = CodeBlock { "Sheet Number"; }
code_block_5 = CodeBlock { 0; "A"; }
insert = String.Insert(str=sheetNumber_4, index=code_block_5.out0, toInsert=code_block_5.out1)
setParameterByName_2 = Element.SetParameterByName(element=slice, parameterName=code_block_4, value=insert)
sheetNumber_5 = Sheet.SheetNumber(setParameterByName_2)
watch_5 = Watch(sheetNumber_5)
