# Dynamo graph UserSelect_AutoNumber_AssemblyNumber.dyn (Dynamo 2.3.0.5885)
# packages: spring nodes 204.1.0, Clockwork for Dynamo 0.6.3 0.63.3

boolean = BoolSelector(true)
ꟿ_collect_currentselection = Custom[ꟿ Collect.CurrentSelection](refresh=boolean)  # package spring nodes; Gets the currently selected elements. Connect a boolean switch to refresh the selection.
watch = Watch(ꟿ_collect_currentselection)
code_block = CodeBlock { "Item Number"; }
code_block_2 = CodeBlock { "Part Level"; }
getParameterValueByName = Element.GetParameterValueByName(element=ꟿ_collect_currentselection, parameterName=code_block_2)
watch_2 = Watch(getParameterValueByName)
code_block_3 = CodeBlock { "-"; }
code_block_4 = CodeBlock { "Assembly Name"; }
getParameterValueByName_2 = Element.GetParameterValueByName(element=ꟿ_collect_currentselection, parameterName=code_block_4)
watch_3 = Watch(getParameterValueByName_2)
code_block_5 = CodeBlock { "-"; }
code_block_6 = CodeBlock { 1; }
count = List.Count(list=ꟿ_collect_currentselection)
code_block_7 = CodeBlock { 1; }
sequence = Sequence(start=code_block_6, amount=count, step=code_block_7)
string_from_object = FromObject(obj=sequence)
code_block_8 = CodeBlock { 3; }
code_block_9 = CodeBlock { "0"; }
padLeft = String.PadLeft(str=string_from_object, newWidth=code_block_8, padChars=code_block_9)
watch_4 = Watch(padLeft)
code_block_10 = CodeBlock(A=watch_2, B=code_block_3, C=watch_3, D=code_block_5, E=watch_4) { A+B+C+D+E; }
watch_5 = Watch(code_block_10)
setParameterByName = Element.SetParameterByName(element=ꟿ_collect_currentselection, parameterName=code_block, value=watch_5)
watch_6 = Watch(setParameterByName)
getCategory = Element.GetCategory(element=ꟿ_collect_currentselection)
get_family_parameter = FamilyInstanceParameters(f=ꟿ_collect_currentselection)  # nothing selected
custom = Custom[]()  # package Clockwork for Dynamo 0.6.3
