# Dynamo graph UserSelect_AutoNumber_Mark & Part Level.dyn (Dynamo 2.3.1.11775)
# packages: spring nodes 204.1.0

boolean = BoolSelector(true)
ꟿ_collect_currentselection = Custom[ꟿ Collect.CurrentSelection](refresh=boolean)  # package spring nodes; Gets the currently selected elements. Connect a boolean switch to refresh the selection.
watch = Watch(ꟿ_collect_currentselection)
code_block = CodeBlock { "Item Number"; }
code_block_2 = CodeBlock { "Mark"; }
getParameterValueByName = Element.GetParameterValueByName(element=ꟿ_collect_currentselection, parameterName=code_block_2)
watch_2 = Watch(getParameterValueByName)
code_block_3 = CodeBlock { "-"; }
code_block_4 = CodeBlock { 1; }
count = List.Count(list=ꟿ_collect_currentselection)
code_block_5 = CodeBlock { 1; }
sequence = Sequence(start=code_block_4, amount=count, step=code_block_5)
string_from_object = FromObject(obj=sequence)
code_block_6 = CodeBlock { 3; }
code_block_7 = CodeBlock { "0"; }
padLeft = String.PadLeft(str=string_from_object, newWidth=code_block_6, padChars=code_block_7)
watch_3 = Watch(padLeft)
code_block_8 = CodeBlock(A=watch_2, B=code_block_3, C=watch_3) { A+B+C; }
watch_4 = Watch(code_block_8)
setParameterByName = Element.SetParameterByName(element=ꟿ_collect_currentselection, parameterName=code_block, value=watch_4)
watch_5 = Watch(setParameterByName)
