# Dynamo graph UserSelect_AutoNumber_Part Level-Color_Part Main-Number.dyn (Dynamo 2.3.1.11775)
# packages: spring nodes 204.1.0

boolean = BoolSelector(true)
ꟿ_collect_currentselection = Custom[ꟿ Collect.CurrentSelection](refresh=boolean)  # package spring nodes; Gets the currently selected elements. Connect a boolean switch to refresh the selection.
watch = Watch(ꟿ_collect_currentselection)
code_block = CodeBlock { "Item Number"; }
code_block_2 = CodeBlock { "Part Level"; }
getParameterValueByName = Element.GetParameterValueByName(element=ꟿ_collect_currentselection, parameterName=code_block_2)
watch_2 = Watch(getParameterValueByName)
code_block_3 = CodeBlock { "Part Color"; }
getParameterValueByName_2 = Element.GetParameterValueByName(element=ꟿ_collect_currentselection, parameterName=code_block_3)
watch_3 = Watch(getParameterValueByName_2)
code_block_4 = CodeBlock { "-"; }
code_block_5 = CodeBlock { "Part is Main"; }
getParameterValueByName_3 = Element.GetParameterValueByName(element=ꟿ_collect_currentselection, parameterName=code_block_5)
watch_4 = Watch(getParameterValueByName_3)
code_block_6 = CodeBlock { 1; }
count = List.Count(list=ꟿ_collect_currentselection)
code_block_7 = CodeBlock { 1; }
sequence = Sequence(start=code_block_6, amount=count, step=code_block_7)
string_from_object = FromObject(obj=sequence)
code_block_8 = CodeBlock { 4; }
code_block_9 = CodeBlock { "0"; }
padLeft = String.PadLeft(str=string_from_object, newWidth=code_block_8, padChars=code_block_9)
watch_5 = Watch(padLeft)
code_block_10 = CodeBlock(A=watch_2, B=watch_3, C=code_block_4, D=watch_4, E=watch_5) { A+B+C+D+E; }
watch_6 = Watch(code_block_10)
setParameterByName = Element.SetParameterByName(element=ꟿ_collect_currentselection, parameterName=code_block, value=watch_6)
watch_7 = Watch(setParameterByName)
